# Requirement set GearSystems (R2021b)

## 1 [#1] GearSystems Requirements (Container)
These requirements define the system level behavior of the landing gear

### 1.1 [#3] UAS X shall have three landing gear subsystems named "LeftMainGear", "RightMainGear", and "NoseGear"

### 1.2 [#4] The gear shall be considered "Retracted" or "up" when the upper limit switch has been closed

### 1.3 [#5] The landing gear shall be considered "Extended" or "down" when the lower limit switch is closed and locked

### 1.4 [#6] The lower limit switch shall be considered locked when it has been closed for 3 continuous seconds

## 2 [#7] Weight On Wheels (WoW) (Container)

### 2.1 [#8] The WoW limit swich shall be enabled when all gear is down and locked AND AltitudeAGL is below 50 ft

### 2.2 [#10] WoW shall be latched when the WoW limit switched has been closed for 3 seconds