# Requirement set PumpControl (R2021b)

## 1 [#1] Pump control (Container)

### 1.1 [#2] The pump control shall recieve enumerated states of "up" or "down"

### 1.2 [#4] The pump control shall return enumerated states of "on" or "off"

### 1.3 [#6] The pump control shall return "on" when the pump is controlled in the commanded direction